# Grasshopper definition phius_rv2024_simulate_ADORB.gh (Grasshopper 1.0.8)

# ----
# Source and Target Files / Folders
config = HBConfig()  # -> python_exe, py_lib_install, rad_install, os_install, ep_install, hb_os_gem, standards, asset_report, default_sim; plug-in component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
ghpython_script = GhPythonScript()  # -> out, root_folder, source_weather_folder, hbrv_weather_folder, hbrv_source_model, hbrv_simulation_save_folder, hbrv_ADORB_results, phius_gui_idf
# ---------- ghpython_script: Python ----------
import os 
import rhinoscriptsyntax as rs

root_folder_ = rs.DocumentPath()
source_weather_folder_ = os.path.join(root_folder_, "_source_weather")

adorb_folder_ = os.path.join(root_folder_, "adorb")

hbrv_weather_folder_ = os.path.join(adorb_folder_, "hbrv_generated_weather")
hbrv_source_model_ = os.path.join(root_folder_, "_source_models", "phius_rv2024_model.hbjson")
hbrv_simulation_save_folder_ = os.path.join(root_folder_, "adorb", "hbrv")
hbrv_ADORB_results_ = os.path.join(hbrv_simulation_save_folder_, "hb_revive_ADORB_results")

phius_gui_idf_ = os.path.join(adorb_folder_, "phius_gui")
# ---------- end ghpython_script ----------
ghpython_script_2 = GhPythonScript(hb_py_lib_install=config.py_lib_install)  # -> out, measure
# ---------- ghpython_script_2: Python ----------
import os 


measure_ = os.path.join(_hb_py_lib_install, "honeybee_revive_measures", "set_revive_people_eplus/")
# ---------- end ghpython_script_2 ----------
ghpython_script_3 = GhPythonScript()  # -> out
# ---------- ghpython_script_3: Python ----------
import scriptcontext as sc
from Grasshopper.Kernel.GH_RuntimeMessageLevel import Error

if str(sc.doc.ModelUnitSystem) != "Meters":
    msg = "Error: Please open this Grasshopper file in a Rhino document which uses 'METERS' as the unit. Otherwise it will not work properly."
    ghenv.Component.AddRuntimeMessage(Error, msg)
else:
    msg = "Units == 'Meters'"

print(msg)
# ---------- end ghpython_script_3 ----------
hb_rv_save_folder = Panel(ghpython_script.hbrv_simulation_save_folder)
adorb_save_folder = Panel(ghpython_script.hbrv_ADORB_results)
phius_gui_idf = Panel(ghpython_script.phius_gui_idf)
panel = Panel(ghpython_script_3)
weather_save_folder = Panel(ghpython_script.source_weather_folder)
weather_save_folder_2 = Panel(ghpython_script.hbrv_weather_folder)
measure_folder = Panel(ghpython_script_2.measure)
hbjson_source_model = Panel(ghpython_script.hbrv_source_model)

# ----
# Phius REVIVE 2024 Test Model
boolean_toggle = BooleanToggle(True)
loadobjects = HBLoadObjects(hb_file=hbjson_source_model, load=boolean_toggle)  # -> out, hb_objs; plug-in component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
ghpython_script_4 = GhPythonScript(model=loadobjects.hb_objs)  # -> out, rooms, shades
# ---------- ghpython_script_4: Python ----------
rooms_ = _model.rooms
shades_ = _model.shades
# ---------- end ghpython_script_4 ----------

# ----
# Turn ‘OFF’ Mech. Ventilation
panel_2 = Panel("0")
applyloadvals = HBApplyLoadValues(room_or_program=flatten(ghpython_script_4.rooms), vent_per_floor=panel_2, vent_per_person=panel_2, vent_ach=panel_2)  # -> out, mod_obj; plug-in component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
absoluteloadvals = HBApplyAbsoluteLoadValues(rooms=flatten(applyloadvals.mod_obj), vent_flow="0")  # -> out, rooms; plug-in component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

# ----
# Turn ‘OFF’ Operable Windows
ventcontrol = HBVentilationControl()  # -> vent_cntrl; plug-in component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
windowopen = HBWindowOpening(rooms=flatten(absoluteloadvals.rooms), vent_cntrl=ventcontrol, fract_area_oper="0", fract_height_oper="0")  # -> report, rooms; plug-in component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

# ----
# REVIVE | HVAC Equipment Properties
panel_3 = Panel("Battery")
create_revive_hvac_equipment_properties = HBREVIVECreateREVIVEHVACEquipmentProperties(name=panel_3, cost="3459", labor_fraction="0.5", lifetime_years="10")  # -> out, hvac_equipment_properties; inputs lifetime_years: Int32
# ---------- create_revive_hvac_equipment_properties: Python ----------
#
# Honeybee-REVIVE: A Plugin for calculating Phius REVIVE using LadybugTools Honeybee-Energy Models
# 
# This component is part of the PH-Tools toolkit <https://github.com/PH-Tools>.
# 
# Copyright (c) 2024, PH-Tools and bldgtyp, llc <phtools@bldgtyp.com> 
# Honeybee-REVIVE is free software; you can redistribute it and/or modify 
# it under the terms of the GNU General Public License as published 
# by the Free Software Foundation; either version 3 of the License, 
# or (at your option) any later version. 
# 
# Honeybee-REVIVE is distributed in the hope that it will be useful,
# but WITHOUT ANY WARRANTY; without even the implied warranty of 
# MERCHANTABILITY or FITNESS FOR A PARTICULAR PURPOSE. See the 
# GNU General Public License for more details.
# 
# For a copy of the GNU General Public License
# see <https://github.com/PH-Tools/honeybee_revive/blob/main/LICENSE>.
# 
# @license GPL-3.0+ <http://spdx.org/licenses/GPL-3.0+>
#
"""
Create a new Phius-REVIVE-HVAC-Equipment-Properties item which can be added to a Honeybee-Room.
Note that this equipment is ONLY for keeping track of the relevant Phius-REVIVE
properties and does NOT add any actual equipment to the Honeybee-Rooms. Use the normal 
Honeybee-Energy components to configure the actual equipment objects on the roonms.
-
EM October 1, 2024
    Args:
        _name: (str) A name for the piece of REVIVE-HVAC-Equipment-Properties.

        _cost: (float) The total purchase-cost of the Appliance.

        _labor_fraction: (float) A number between 0 and 1.0 representing the percentage
            of the appliance cost related to labor, as opposed to material. 

        _lifetime_years: (float) The total number of years the appliance will last
            before it needs to be completely replaced. 

    Returns:
        hvac_equipment_properties_: (Process) The Honeybee-REVIVE-HVAC-Properties which can be added
            a Honeybee-Room.
"""

import scriptcontext as sc
import Rhino as rh
import rhinoscriptsyntax as rs
import ghpythonlib.components as ghc
import Grasshopper as gh

try:
    from ph_gh_component_io import gh_io
except ImportError as e:
    raise ImportError('\nFailed to import ph_gh_component_io:\n\t{}'.format(e))

try:
    from honeybee_revive_rhino import gh_compo_io
except ImportError as e:
    raise ImportError('\nFailed to import honeybee_revive_rhino:\n\t{}'.format(e))


# ------------------------------------------------------------------------------
import honeybee_revive_rhino._component_info_
reload(honeybee_revive_rhino._component_info_)
ghenv.Component.Name = "HB-REVIVE - Create REVIVE HVAC Equipment Properties"
DEV = honeybee_revive_rhino._component_info_.set_component_params(ghenv, dev=False)
if DEV:
    from honeybee_revive_rhino.gh_compo_io.equipment import hvac_create_properties as gh_compo_io
    reload(gh_compo_io)
    
# ------------------------------------------------------------------------------
# -- GH Interface
IGH = gh_io.IGH( ghdoc, ghenv, sc, rh, rs, ghc, gh )

# ------------------------------------------------------------------------------
gh_compo_interface = gh_compo_io.GHCompo_CreateReviveHvacEquipmentProperties(
        IGH,
        _name,
        _cost,
        _labor_fraction,
        _lifetime_years,
)
hvac_equipment_properties_ = gh_compo_interface.run()
print hvac_equipment_properties_
# ---------- end create_revive_hvac_equipment_properties ----------
create_revive_hvac_equipment_properties_2 = HBREVIVECreateREVIVEHVACEquipmentProperties(name="GasFurnaceDXAC", cost="7500", labor_fraction="0.4", lifetime_years="20")  # -> out, hvac_equipment_properties; inputs lifetime_years: Int32; same code as create_revive_hvac_equipment_properties
create_revive_hvac_equipment_properties_3 = HBREVIVECreateREVIVEHVACEquipmentProperties(name="DHW_NaturalGas", cost="1000", labor_fraction="0.8", lifetime_years="13")  # -> out, hvac_equipment_properties; inputs lifetime_years: Int32; same code as create_revive_hvac_equipment_properties
add_revive_hvac_equipment_properties_to = HBREVIVEAddREVIVEHVACEquipmentPropertiesToRooms(
    equipment_properties=flatten([create_revive_hvac_equipment_properties_2.hvac_equipment_properties, create_revive_hvac_equipment_properties_3.hvac_equipment_properties, create_revive_hvac_equipment_properties.hvac_equipment_properties]),
    hb_rooms=flatten(windowopen.rooms))  # -> out, hb_rooms; "Add REVIVE HVAC Equipment Properties to Rooms"; inputs equipment_properties: list, hb_rooms: list
# ---------- add_revive_hvac_equipment_properties_to: Python ----------
#
# Honeybee-REVIVE: A Plugin for calculating Phius REVIVE using LadybugTools Honeybee-Energy Models
# 
# This component is part of the PH-Tools toolkit <https://github.com/PH-Tools>.
# 
# Copyright (c) 2024, PH-Tools and bldgtyp, llc <phtools@bldgtyp.com> 
# Honeybee-REVIVE is free software; you can redistribute it and/or modify 
# it under the terms of the GNU General Public License as published 
# by the Free Software Foundation; either version 3 of the License, 
# or (at your option) any later version. 
# 
# Honeybee-REVIVE is distributed in the hope that it will be useful,
# but WITHOUT ANY WARRANTY; without even the implied warranty of 
# MERCHANTABILITY or FITNESS FOR A PARTICULAR PURPOSE. See the 
# GNU General Public License for more details.
# 
# For a copy of the GNU General Public License
# see <https://github.com/PH-Tools/honeybee_revive/blob/main/LICENSE>.
# 
# @license GPL-3.0+ <http://spdx.org/licenses/GPL-3.0+>
#
"""
Add Phius-REVIVE-HVAC-Equipment-Properties onto Honeybee-Rooms.
-
EM October 1, 2024
    Args:
        _equipment_properties: (list[]) The new Phius-REVIVE-HVAC-Equiment-Properties
            to add to the Honeybee-Rooms.

        _hb_rooms: (list[Room]) The Honeybee-Rooms to add the new Phius-REVIVE
            HVAC-Properties to.

    Returns:
        hb_rooms_: (list[Room]) The Honeybee-Rooms with the Phius-REVIVE HVAC
            Equipment Properties added. 
"""

import scriptcontext as sc
import Rhino as rh
import rhinoscriptsyntax as rs
import ghpythonlib.components as ghc
import Grasshopper as gh

try:
    from ph_gh_component_io import gh_io
except ImportError as e:
    raise ImportError('\nFailed to import ph_gh_component_io:\n\t{}'.format(e))

try:
    from honeybee_revive_rhino import gh_compo_io
except ImportError as e:
    raise ImportError('\nFailed to import honeybee_revive_rhino:\n\t{}'.format(e))


# ------------------------------------------------------------------------------
import honeybee_revive_rhino._component_info_
reload(honeybee_revive_rhino._component_info_)
ghenv.Component.Name = "HB-REVIVE - Add REVIVE HVAC Equipment Properties to Rooms"
DEV = honeybee_revive_rhino._component_info_.set_component_params(ghenv, dev=False)
if DEV:
    from honeybee_revive_rhino.gh_compo_io.equipment import hvac_add_properties_to_room as gh_compo_io
    reload(gh_compo_io)
    
# ------------------------------------------------------------------------------
# -- GH Interface
IGH = gh_io.IGH( ghdoc, ghenv, sc, rh, rs, ghc, gh )

# ------------------------------------------------------------------------------
gh_compo_interface = gh_compo_io.GHCompo_AddHvacEquipmentPropertiesToRooms(
        IGH,
        _equipment_properties,
        _hb_rooms,
)
hb_rooms_ = gh_compo_interface.run()
print hb_rooms_
# ---------- end add_revive_hvac_equipment_properties_to ----------

# ----
# REVIVE | Appliances
panel_4 = Panel("rv2024_Cooktop")
load_revive_schedules_from_standards = HBREVIVELoadREVIVESchedulesFromStandards(schedule_names="rv2024_MEL")  # -> out, schedules; inputs schedule_names: list
# ---------- load_revive_schedules_from_standards: Python ----------
#
# Honeybee-REVIVE: A Plugin for calculating Phius REVIVE using LadybugTools Honeybee-Energy Models
# 
# This component is part of the PH-Tools toolkit <https://github.com/PH-Tools>.
# 
# Copyright (c) 2024, PH-Tools and bldgtyp, llc <phtools@bldgtyp.com> 
# Honeybee-REVIVE is free software; you can redistribute it and/or modify 
# it under the terms of the GNU General Public License as published 
# by the Free Software Foundation; either version 3 of the License, 
# or (at your option) any later version. 
# 
# Honeybee-REVIVE is distributed in the hope that it will be useful,
# but WITHOUT ANY WARRANTY; without even the implied warranty of 
# MERCHANTABILITY or FITNESS FOR A PARTICULAR PURPOSE. See the 
# GNU General Public License for more details.
# 
# For a copy of the GNU General Public License
# see <https://github.com/PH-Tools/honeybee_revive/blob/main/LICENSE>.
# 
# @license GPL-3.0+ <http://spdx.org/licenses/GPL-3.0+>
#
"""
Load the Honeybee-Energy Schedules from the Phius-REVIVE-2024 Standards Library. This 
Schedule can be assigned to one or more Honeybee-Rooms.
-
EM November 1, 2024
    Args:
        _standards_path_: (str | None) OPTIONAL path to the Phius-REVIVE-2024 Standards Path 
            that you would like to use. If None is provided, the default standards 
            directory location will be used.

        _schedule_names_: (str | None) OPTIONAL names for the Phius-REVIVE-2024 Schedules
            to load from the Standards directory. Note that if No name is provided, the 
            component will load all of the Phius REVIVE Schedules.

    Returns:
        schedules_: (ProgramType | None) The Honeybee-Energy Schedules found in
            the Phius REVIVE 2024 Standards directory, or None if not found. 
"""

import scriptcontext as sc
import Rhino as rh
import rhinoscriptsyntax as rs
import ghpythonlib.components as ghc
import Grasshopper as gh

try:
    from ph_gh_component_io import gh_io
except ImportError as e:
    raise ImportError('\nFailed to import ph_gh_component_io:\n\t{}'.format(e))

try:
    from honeybee_revive_rhino import gh_compo_io
except ImportError as e:
    raise ImportError('\nFailed to import honeybee_revive_rhino:\n\t{}'.format(e))


# ------------------------------------------------------------------------------
import honeybee_revive_rhino._component_info_
reload(honeybee_revive_rhino._component_info_)
ghenv.Component.Name = "HB-REVIVE - Load REVIVE Schedules from Standards"
DEV = honeybee_revive_rhino._component_info_.set_component_params(ghenv, dev=False)
if DEV:
    from honeybee_revive_rhino.gh_compo_io.standards import load_schedules_from_standards as gh_compo_io
    reload(gh_compo_io)
    
# ------------------------------------------------------------------------------
# -- GH Interface
IGH = gh_io.IGH( ghdoc, ghenv, sc, rh, rs, ghc, gh )

# ------------------------------------------------------------------------------
gh_compo_interface = gh_compo_io.GHCompo_LoadSchedulesFromStandards(
        IGH,
        _standards_path_,
)
all_schedules = gh_compo_interface.run()
for schedule in all_schedules:
    print schedule.display_name


if _schedule_names_:
    shcd_names = [s.upper().strip() for s in _schedule_names_]
    schedules_ = [s for s in all_schedules if s.display_name.upper().strip() in shcd_names]
else:
    schedules_ = all_schedules
# ---------- end load_revive_schedules_from_standards ----------
load_revive_schedules_from_standards_2 = HBREVIVELoadREVIVESchedulesFromStandards(schedule_names=panel_4)  # -> out, schedules; inputs schedule_names: list; same code as load_revive_schedules_from_standards
load_revive_schedules_from_standards_3 = HBREVIVELoadREVIVESchedulesFromStandards(schedule_names="rv2024_Clotheswasher")  # -> out, schedules; inputs schedule_names: list; same code as load_revive_schedules_from_standards
load_revive_schedules_from_standards_4 = HBREVIVELoadREVIVESchedulesFromStandards(schedule_names="rv2024_Refrigerator")  # -> out, schedules; inputs schedule_names: list; same code as load_revive_schedules_from_standards
load_revive_schedules_from_standards_5 = HBREVIVELoadREVIVESchedulesFromStandards(schedule_names="rv2024_Clothesdryer")  # -> out, schedules; inputs schedule_names: list; same code as load_revive_schedules_from_standards
load_revive_schedules_from_standards_6 = HBREVIVELoadREVIVESchedulesFromStandards(schedule_names="rv2024_Dishwasher")  # -> out, schedules; inputs schedule_names: list; same code as load_revive_schedules_from_standards
create_revive_appliance = HBREVIVECreateREVIVEAppliance(
    name="WholeHouse Fridge",
    watts="41.0958904109589",
    schedule=load_revive_schedules_from_standards_4.schedules,
    fuel_type="Electricity",
    use_category="Fridge",
    radiant_fract="0",
    latent_fract="0",
    lost_fract="0")  # -> out, appliance
# ---------- create_revive_appliance: Python ----------
#
# Honeybee-REVIVE: A Plugin for calculating Phius REVIVE using LadybugTools Honeybee-Energy Models
# 
# This component is part of the PH-Tools toolkit <https://github.com/PH-Tools>.
# 
# Copyright (c) 2024, PH-Tools and bldgtyp, llc <phtools@bldgtyp.com> 
# Honeybee-REVIVE is free software; you can redistribute it and/or modify 
# it under the terms of the GNU General Public License as published 
# by the Free Software Foundation; either version 3 of the License, 
# or (at your option) any later version. 
# 
# Honeybee-REVIVE is distributed in the hope that it will be useful,
# but WITHOUT ANY WARRANTY; without even the implied warranty of 
# MERCHANTABILITY or FITNESS FOR A PARTICULAR PURPOSE. See the 
# GNU General Public License for more details.
# 
# For a copy of the GNU General Public License
# see <https://github.com/PH-Tools/honeybee_revive/blob/main/LICENSE>.
# 
# @license GPL-3.0+ <http://spdx.org/licenses/GPL-3.0+>
#
"""
Create a new Honeybee-REVIVE Appliance which can be added to one or more Honeybee-Rooms.
-
EM October 1, 2024
    Args:
        _name_: (str) Text to set the name for the Appliance and to be incorporated into a
            unique Appliance identifier. If None, a unique name will be
            generated.
        
        _watts: (float) A number for the process load power in Watts.
        
        _schedule: A fractional schedule for the use of the process over the course of
            the year. The fractional values will get multiplied by the _watts
            to yield a complete process load profile.
        
        _fuel_type: (str) Text to denote the type of fuel consumed by the Appliance. Using the
            "None" type indicates that no end uses will be associated with the
            Appliance, only the zone gains. Choose from the following.
                * Electricity
                * NaturalGas
                * Propane
                * FuelOilNo1
                * FuelOilNo2
                * Diesel
                * Gasoline
                * Coal
                * Steam
                * DistrictHeating
                * DistrictCooling
                * OtherFuel1
                * OtherFuel2
                * None
        
        use_category_: Text to indicate the end-use subcategory, which will identify
            the appliance load in the EUI output. For example, “Cooking”,
            “Clothes Drying”, etc. (Default: General).
        
        radiant_fract_: A number between 0 and 1 for the fraction of the total
            appliance load given off as long wave radiant heat. (Default: 0).
        
        latent_fract_: A number between 0 and 1 for the fraction of the total
            appliance load that is latent (as opposed to sensible). (Default: 0).
        
        lost_fract_: A number between 0 and 1 for the fraction of the total
            appliance load that is lost outside of the zone and the HVAC system.
            Typically, this is used to represent heat that is exhausted directly
            out of a zone (as you would for a stove). (Default: 0).

    Returns:
        appliance_: (Process) The new Honeybee-REVIVE Appliance which can be added
            to one or more Honeybee-Rooms.
"""

import scriptcontext as sc
import Rhino as rh
import rhinoscriptsyntax as rs
import ghpythonlib.components as ghc
import Grasshopper as gh

try:
    from ph_gh_component_io import gh_io
except ImportError as e:
    raise ImportError('\nFailed to import ph_gh_component_io:\n\t{}'.format(e))

try:
    from honeybee_revive_rhino import gh_compo_io
except ImportError as e:
    raise ImportError('\nFailed to import honeybee_revive_rhino:\n\t{}'.format(e))


# ------------------------------------------------------------------------------
import honeybee_revive_rhino._component_info_
reload(honeybee_revive_rhino._component_info_)
ghenv.Component.Name = "HB-REVIVE - Create REVIVE Appliance"
DEV = honeybee_revive_rhino._component_info_.set_component_params(ghenv, dev=False)
if DEV:
    from honeybee_revive_rhino.gh_compo_io.equipment import appliances_create as gh_compo_io
    reload(gh_compo_io)
    
# ------------------------------------------------------------------------------
# -- GH Interface
IGH = gh_io.IGH( ghdoc, ghenv, sc, rh, rs, ghc, gh )

# ------------------------------------------------------------------------------
gh_compo_interface = gh_compo_io.GHCompo_CreateReviveAppliance(
        IGH,
        _name_,
        _watts,
        _schedule,
        _fuel_type,
        use_category_,
        radiant_fract_,
        latent_fract_,
        lost_fract_,
)
appliance_ = gh_compo_interface.run()
print appliance_
# ---------- end create_revive_appliance ----------
create_revive_appliance_2 = HBREVIVECreateREVIVEAppliance(
    name="WholeHouse Range",
    watts="1441.0958904109589",
    schedule=load_revive_schedules_from_standards_2.schedules,
    fuel_type="Electricity",
    use_category="Range",
    radiant_fract="0.3",
    latent_fract="0.4",
    lost_fract="0")  # -> out, appliance; same code as create_revive_appliance
create_revive_appliance_3 = HBREVIVECreateREVIVEAppliance(
    name="WholeHouse PhiusMELs",
    watts="5184.621141459727",
    schedule=load_revive_schedules_from_standards.schedules,
    fuel_type="Electricity",
    use_category="MELs",
    radiant_fract="0",
    latent_fract="0",
    lost_fract="0")  # -> out, appliance; same code as create_revive_appliance
create_revive_appliance_4 = HBREVIVECreateREVIVEAppliance(
    name="WholeHouse ClothesDryer",
    watts="3932.3728950917466",
    schedule=load_revive_schedules_from_standards_5.schedules,
    fuel_type="Electricity",
    use_category="ClothesDryer",
    radiant_fract="0.05",
    latent_fract="0.15",
    lost_fract="0")  # -> out, appliance; same code as create_revive_appliance
create_revive_appliance_5 = HBREVIVECreateREVIVEAppliance(
    name="WholeHouse ClothesWasher",
    watts="438.35616438356163",
    schedule=load_revive_schedules_from_standards_3.schedules,
    fuel_type="Electricity",
    use_category="ClothesWasher",
    radiant_fract="0",
    latent_fract="0.8",
    lost_fract="0")  # -> out, appliance; same code as create_revive_appliance
create_revive_appliance_6 = HBREVIVECreateREVIVEAppliance(
    name="WholeHouse Dishwasher",
    watts="778.6234087288946",
    schedule=load_revive_schedules_from_standards_6.schedules,
    fuel_type="Electricity",
    use_category="Dishwasher",
    radiant_fract="0.15",
    latent_fract="0.6",
    lost_fract="0")  # -> out, appliance; same code as create_revive_appliance
set_revive_appliance_properties = HBREVIVESetREVIVEApplianceProperties(cost="611", labor_fraction="0.15", lifetime_years="17", appliance=create_revive_appliance.appliance)  # -> out, appliance
# ---------- set_revive_appliance_properties: Python ----------
#
# Honeybee-REVIVE: A Plugin for calculating Phius REVIVE using LadybugTools Honeybee-Energy Models
# 
# This component is part of the PH-Tools toolkit <https://github.com/PH-Tools>.
# 
# Copyright (c) 2024, PH-Tools and bldgtyp, llc <phtools@bldgtyp.com> 
# Honeybee-REVIVE is free software; you can redistribute it and/or modify 
# it under the terms of the GNU General Public License as published 
# by the Free Software Foundation; either version 3 of the License, 
# or (at your option) any later version. 
# 
# Honeybee-REVIVE is distributed in the hope that it will be useful,
# but WITHOUT ANY WARRANTY; without even the implied warranty of 
# MERCHANTABILITY or FITNESS FOR A PARTICULAR PURPOSE. See the 
# GNU General Public License for more details.
# 
# For a copy of the GNU General Public License
# see <https://github.com/PH-Tools/honeybee_revive/blob/main/LICENSE>.
# 
# @license GPL-3.0+ <http://spdx.org/licenses/GPL-3.0+>
#
"""
Set the Honeybee-REVIVE properties on a Honeybee-REVIVE Appliance.
-
EM October 1, 2024
    Args:
        _cost: (float) The total purchase-cost of the Appliance.

        _labor_fraction: (float) A number between 0 and 1.0 representing the percentage
            of the appliance cost related to labor, as opposed to material. 

        _lifetime_years: (float) The total number of years the appliance will last
            before it needs to be completely replaced. 

        _appliance: (Process) The Hoenybee-REVIVE Appliance to set the properties on.

    Returns:
        appliance_: (Process) The Honeybee-REVIVE Appliance with the properties set.
"""

import scriptcontext as sc
import Rhino as rh
import rhinoscriptsyntax as rs
import ghpythonlib.components as ghc
import Grasshopper as gh

try:
    from ph_gh_component_io import gh_io
except ImportError as e:
    raise ImportError('\nFailed to import ph_gh_component_io:\n\t{}'.format(e))

try:
    from honeybee_revive_rhino import gh_compo_io
except ImportError as e:
    raise ImportError('\nFailed to import honeybee_revive_rhino:\n\t{}'.format(e))


# ------------------------------------------------------------------------------
import honeybee_revive_rhino._component_info_
reload(honeybee_revive_rhino._component_info_)
ghenv.Component.Name = "HB-REVIVE - Set REVIVE Appliance Properties"
DEV = honeybee_revive_rhino._component_info_.set_component_params(ghenv, dev=False)
if DEV:
    from honeybee_revive_rhino.gh_compo_io.equipment import appliances_set_revive_properties as gh_compo_io
    reload(gh_compo_io)
    
# ------------------------------------------------------------------------------
# -- GH Interface
IGH = gh_io.IGH( ghdoc, ghenv, sc, rh, rs, ghc, gh )

# ------------------------------------------------------------------------------
gh_compo_interface = gh_compo_io.GHCompo_SetApplianceReviveProperties(
        IGH,
        _cost,
        _labor_fraction,
        _lifetime_years,
        _appliance,
)
appliance_ = gh_compo_interface.run()
print appliance_
# ---------- end set_revive_appliance_properties ----------
set_revive_appliance_properties_2 = HBREVIVESetREVIVEApplianceProperties(cost="992", labor_fraction="0.1", lifetime_years="13", appliance=create_revive_appliance_2.appliance)  # -> out, appliance; same code as set_revive_appliance_properties
set_revive_appliance_properties_3 = HBREVIVESetREVIVEApplianceProperties(cost="0", labor_fraction="1", lifetime_years="0", appliance=create_revive_appliance_3.appliance)  # -> out, appliance; same code as set_revive_appliance_properties
set_revive_appliance_properties_4 = HBREVIVESetREVIVEApplianceProperties(cost="1000", labor_fraction="0.1", lifetime_years="13", appliance=create_revive_appliance_4.appliance)  # -> out, appliance; same code as set_revive_appliance_properties
set_revive_appliance_properties_5 = HBREVIVESetREVIVEApplianceProperties(cost="662", labor_fraction="0.1", lifetime_years="14", appliance=create_revive_appliance_5.appliance)  # -> out, appliance; same code as set_revive_appliance_properties
set_revive_appliance_properties_6 = HBREVIVESetREVIVEApplianceProperties(cost="959", labor_fraction="0.1", lifetime_years="11", appliance=create_revive_appliance_6.appliance)  # -> out, appliance; same code as set_revive_appliance_properties
merge = Merge(
    Data1=set_revive_appliance_properties_3.appliance,
    Data2=set_revive_appliance_properties.appliance,
    Data3=set_revive_appliance_properties_2.appliance,
    Data4=set_revive_appliance_properties_4.appliance,
    Data5=set_revive_appliance_properties_5.appliance,
    Data6=set_revive_appliance_properties_6.appliance)
add_revive_appliances_to_rooms = HBREVIVEAddREVIVEAppliancesToRooms(appliances=merge, hb_rooms=add_revive_hvac_equipment_properties_to.hb_rooms)  # -> out, hb_rooms; inputs appliances: list, hb_rooms: list
# ---------- add_revive_appliances_to_rooms: Python ----------
#
# Honeybee-REVIVE: A Plugin for calculating Phius REVIVE using LadybugTools Honeybee-Energy Models
# 
# This component is part of the PH-Tools toolkit <https://github.com/PH-Tools>.
# 
# Copyright (c) 2024, PH-Tools and bldgtyp, llc <phtools@bldgtyp.com> 
# Honeybee-REVIVE is free software; you can redistribute it and/or modify 
# it under the terms of the GNU General Public License as published 
# by the Free Software Foundation; either version 3 of the License, 
# or (at your option) any later version. 
# 
# Honeybee-REVIVE is distributed in the hope that it will be useful,
# but WITHOUT ANY WARRANTY; without even the implied warranty of 
# MERCHANTABILITY or FITNESS FOR A PARTICULAR PURPOSE. See the 
# GNU General Public License for more details.
# 
# For a copy of the GNU General Public License
# see <https://github.com/PH-Tools/honeybee_revive/blob/main/LICENSE>.
# 
# @license GPL-3.0+ <http://spdx.org/licenses/GPL-3.0+>
#
"""
Add one or more Honeybee-REVIVE Appliances to a group of Honeybee-Rooms. 
NOTE that ALL of the appliances will be added to ALL of the rooms. So you 
may want to break out the rooms and assign the appliances separately (for instance
if you are assigning a Cooktop, be sure that this gets assigned only to one room.)
-
EM October 1, 2024
    Args:
        _appliances: (list[Process]) The appliances to add to each of the 
            Honeybee-Rooms

        _hb_rooms: (list[Room]) The Honeybee-Rooms to have the appliances added.

    Returns:
        hb_rooms_: (list[Room]) The Honeybee-Rooms with the Appliances added. 
"""

import scriptcontext as sc
import Rhino as rh
import rhinoscriptsyntax as rs
import ghpythonlib.components as ghc
import Grasshopper as gh

try:
    from ph_gh_component_io import gh_io
except ImportError as e:
    raise ImportError('\nFailed to import ph_gh_component_io:\n\t{}'.format(e))

try:
    from honeybee_revive_rhino import gh_compo_io
except ImportError as e:
    raise ImportError('\nFailed to import honeybee_revive_rhino:\n\t{}'.format(e))


# ------------------------------------------------------------------------------
import honeybee_revive_rhino._component_info_
reload(honeybee_revive_rhino._component_info_)
ghenv.Component.Name = "HB-REVIVE - Add REVIVE Appliances to Rooms"
DEV = honeybee_revive_rhino._component_info_.set_component_params(ghenv, dev=False)
if DEV:
    from honeybee_revive_rhino.gh_compo_io.equipment import appliances_add_to_room as gh_compo_io
    reload(gh_compo_io)
    
# ------------------------------------------------------------------------------
# -- GH Interface
IGH = gh_io.IGH( ghdoc, ghenv, sc, rh, rs, ghc, gh )

# ------------------------------------------------------------------------------
gh_compo_interface = gh_compo_io.GHCompo_AddReviveAppliancesToRooms(
        IGH,
        _appliances,
        _hb_rooms,
)
hb_rooms_ = gh_compo_interface.run()
# ---------- end add_revive_appliances_to_rooms ----------

# ---- group: Rooftop PV
# REVIVE | Shading & PV
cluster = Cluster(hb_objs=add_revive_appliances_to_rooms.hb_rooms)
shade = HBShade(geo=cluster)  # -> out, shades; plug-in component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
photovoltaic = HBPhotovoltaicProperties(shades=shade.shades)  # -> out, shades; plug-in component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
set_revive_pv_shade_properties = HBREVIVESetREVIVEPVShadeProperties(cost="5", labor_fraction="0.25", lifetime_years="25", hb_shades=photovoltaic.shades)  # -> out, hb_shades; inputs lifetime_years: Int32, hb_shades: list
# ---------- set_revive_pv_shade_properties: Python ----------
#
# Honeybee-REVIVE: A Plugin for calculating Phius REVIVE using LadybugTools Honeybee-Energy Models
# 
# This component is part of the PH-Tools toolkit <https://github.com/PH-Tools>.
# 
# Copyright (c) 2024, PH-Tools and bldgtyp, llc <phtools@bldgtyp.com> 
# Honeybee-REVIVE is free software; you can redistribute it and/or modify 
# it under the terms of the GNU General Public License as published 
# by the Free Software Foundation; either version 3 of the License, 
# or (at your option) any later version. 
# 
# Honeybee-REVIVE is distributed in the hope that it will be useful,
# but WITHOUT ANY WARRANTY; without even the implied warranty of 
# MERCHANTABILITY or FITNESS FOR A PARTICULAR PURPOSE. See the 
# GNU General Public License for more details.
# 
# For a copy of the GNU General Public License
# see <https://github.com/PH-Tools/honeybee_revive/blob/main/LICENSE>.
# 
# @license GPL-3.0+ <http://spdx.org/licenses/GPL-3.0+>
#
"""
Add Phius-REVIVE properties to one or more Honeybee-Shade objects which have 
PV (Photovoltaic) panels on them. Note that you should use the Honeybee-Energy
'HB Photovoltaic Properties' component to set up the basic PV panel attributes
FIRST before using this componet to set the Phius-REVIVE properties.
-
EM October 1, 2024
    Args:
        _cost: (float) The total cost of the PV

        _labor_fraction: (float) The fraction of the PV cost associated with labor,
            as opposed to material.

        _lifetime_years: (float) The lifetime (in years) of the PV

        _hb_shades: (list[Shade]) A list of Honeybee-Energy Shade objects which 
            have PV-Modules added to them.

    Returns:
        hb_shades_: (list[Shade]) The Honeybee-Energy-Shade objects with their 
            Phius-REVIVE properties set. These Shades can be added to a Honeybee-Model.
"""

import scriptcontext as sc
import Rhino as rh
import rhinoscriptsyntax as rs
import ghpythonlib.components as ghc
import Grasshopper as gh

try:
    from ph_gh_component_io import gh_io
except ImportError as e:
    raise ImportError('\nFailed to import ph_gh_component_io:\n\t{}'.format(e))

try:
    from honeybee_revive_rhino import gh_compo_io
except ImportError as e:
    raise ImportError('\nFailed to import honeybee_revive_rhino:\n\t{}'.format(e))


# ------------------------------------------------------------------------------
import honeybee_revive_rhino._component_info_
reload(honeybee_revive_rhino._component_info_)
ghenv.Component.Name = "HB-REVIVE - Set REVIVE PV-Shade Properties"
DEV = honeybee_revive_rhino._component_info_.set_component_params(ghenv, dev=False)
if DEV:
    from honeybee_revive_rhino.gh_compo_io.equipment import pv_set_shade_properties as gh_compo_io
    reload(gh_compo_io)
    
# ------------------------------------------------------------------------------
# -- GH Interface
IGH = gh_io.IGH( ghdoc, ghenv, sc, rh, rs, ghc, gh )

# ------------------------------------------------------------------------------
gh_compo_interface = gh_compo_io.GHCompo_SetPvShadeProperties(
        IGH,
        _cost,
        _labor_fraction,
        _lifetime_years,
        _hb_shades,
)
hb_shades_ = gh_compo_interface.run()
# ---------- end set_revive_pv_shade_properties ----------

# ----
# ALT: Testing IdealAir Loads
# You can turn this on for testing the models in
# IdealAirLoads configuration. Note that you need
# to be sure to set the humidification setpoint to
# match the Phius model in this case.
panel_5 = Panel("25")  # disabled
panel_6 = Panel("20")  # disabled
panel_7 = Panel("60")  # disabled
applysetpointvals = HBApplySetpointValues(
    room_or_program=flatten(add_revive_appliances_to_rooms.hb_rooms),
    cooling_setpt=panel_5,
    heating_setpt=panel_6,
    humid_setpt=panel_7,
    dehumid_setpt=panel_7)  # -> out, mod_obj; disabled; plug-in component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
idealair = HBIdealAir(rooms=flatten(applysetpointvals.mod_obj))  # -> out, rooms; disabled; plug-in component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

merge_2 = Merge(Data1=ghpython_script_4.shades)
flatten_tree = FlattenTree(Tree=merge_2, Path="{0}")

model = HBModel(rooms=flatten(add_revive_appliances_to_rooms.hb_rooms), shades=flatten(flatten_tree), name="hb_revive_ADORB_model")  # -> out, model; plug-in component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

# ----
# REVIVE | CO2 Measures
# Not included in reference model
value_list = ValueList({"PERFORMANCE": "1-PERFORMANCE", "NON-PERFORMANCE": "2-NON_PERFORMANCE"}, selected="PERFORMANCE")  # disabled
panel_8 = Panel("""HP Replace 1
HP Replace 2""")  # disabled
panel_9 = Panel("HP Replace 3")  # disabled
panel_10 = Panel("60")  # disabled
panel_11 = Panel("8500")  # disabled
panel_12 = Panel("USA")  # disabled
panel_13 = Panel("0.4")  # disabled
load_revive_co2_measures_from_standards = HBREVIVELoadREVIVECO2MeasuresFromStandardsLibrary(measure_names=panel_8)  # -> out, measures; "Load REVIVE CO2-Measures from Standards Library"; inputs measure_names: list; disabled
#   port measure_names: (str) The name of the Measure to search the Standards library for.
# ---------- load_revive_co2_measures_from_standards: Python ----------
#
# Honeybee-REVIVE: A Plugin for calculating Phius REVIVE using LadybugTools Honeybee-Energy Models
# 
# This component is part of the PH-Tools toolkit <https://github.com/PH-Tools>.
# 
# Copyright (c) 2024, PH-Tools and bldgtyp, llc <phtools@bldgtyp.com> 
# Honeybee-REVIVE is free software; you can redistribute it and/or modify 
# it under the terms of the GNU General Public License as published 
# by the Free Software Foundation; either version 3 of the License, 
# or (at your option) any later version. 
# 
# Honeybee-REVIVE is distributed in the hope that it will be useful,
# but WITHOUT ANY WARRANTY; without even the implied warranty of 
# MERCHANTABILITY or FITNESS FOR A PARTICULAR PURPOSE. See the 
# GNU General Public License for more details.
# 
# For a copy of the GNU General Public License
# see <https://github.com/PH-Tools/honeybee_revive/blob/main/LICENSE>.
# 
# @license GPL-3.0+ <http://spdx.org/licenses/GPL-3.0+>
#
"""
Load a CO2-Reduction-Measure from the Honeybee-REVIVE Standards Library.
-
EM OCtober 1, 2024
    Args:
        _measuere_names: (list[str]) The name or names of the Measures to search the 
            Standards library for.

    Returns:
        measures_: (list[CO2ReductionMeasure]) The Measures, if found.
"""

import scriptcontext as sc
import Rhino as rh
import rhinoscriptsyntax as rs
import ghpythonlib.components as ghc
import Grasshopper as gh

try:
    from ph_gh_component_io import gh_io
except ImportError as e:
    raise ImportError('\nFailed to import ph_gh_component_io:\n\t{}'.format(e))

try:
    from honeybee_revive_rhino import gh_compo_io
except ImportError as e:
    raise ImportError('\nFailed to import honeybee_revive_rhino:\n\t{}'.format(e))


# ------------------------------------------------------------------------------
import honeybee_revive_rhino._component_info_
reload(honeybee_revive_rhino._component_info_)

ghenv.Component.Name = "HB-REVIVE - Load REVIVE CO2-Measures from Standards Library"
DEV = honeybee_revive_rhino._component_info_.set_component_params(ghenv, dev=False)
if DEV:
    from honeybee_revive_rhino.gh_compo_io.standards import load_CO2_measure_from_standards as gh_compo_io
    reload(gh_compo_io)

# ------------------------------------------------------------------------------
# -- GH Interface
IGH = gh_io.IGH( ghdoc, ghenv, sc, rh, rs, ghc, gh )

# ------------------------------------------------------------------------------
gh_compo_interface = gh_compo_io.GHCompo_LoadCO2ReductionMeasure(
        IGH,
        _measure_names,
)
measures_ = gh_compo_interface.run()
for m in measures_:
    print(m)
# ---------- end load_revive_co2_measures_from_standards ----------
create_co2_reduction_measure = HBREVIVECreateCO2ReductionMeasure(name=panel_9, measure_type=value_list, year=panel_10, cost=panel_11, country_name=panel_12, labor_fraction=panel_13)  # -> out, measure; inputs year: Int32; disabled
# ---------- create_co2_reduction_measure: Python ----------
#
# Honeybee-REVIVE: A Plugin for calculating Phius REVIVE using LadybugTools Honeybee-Energy Models
# 
# This component is part of the PH-Tools toolkit <https://github.com/PH-Tools>.
# 
# Copyright (c) 2024, PH-Tools and bldgtyp, llc <phtools@bldgtyp.com> 
# Honeybee-REVIVE is free software; you can redistribute it and/or modify 
# it under the terms of the GNU General Public License as published 
# by the Free Software Foundation; either version 3 of the License, 
# or (at your option) any later version. 
# 
# Honeybee-REVIVE is distributed in the hope that it will be useful,
# but WITHOUT ANY WARRANTY; without even the implied warranty of 
# MERCHANTABILITY or FITNESS FOR A PARTICULAR PURPOSE. See the 
# GNU General Public License for more details.
# 
# For a copy of the GNU General Public License
# see <https://github.com/PH-Tools/honeybee_revive/blob/main/LICENSE>.
# 
# @license GPL-3.0+ <http://spdx.org/licenses/GPL-3.0+>
#
"""
Create a new Phius-REVIVE CO2 Reduction Measure which can be applied to a
Honeybee Model. Note that a Honeybee Model can have several measures applied.
-
EM October 1, 2024
    Args:
        _name: (str) The name to give to the CO2-Reduction-Measure

        _measure_type: (CO2ReductionMeasureType) Input either:
            "1-PERFORMANCE"
            "2-NON_PERFORMANCE"
            
        _year: (int) The year

        _cost: (float) The cost of the measure.

        _kg_CO2: (float) The KG of CO2e reduced by the measure.

        _country_name: (str) The name of the country.

        _labor_fraction: (float) The percentage of the measure which is 
            related to labor, as opposed to material.

    Returns:
        measure_: (CO2ReductionMeasure) The new CO2-Reduction-Measure which can 
            be added to a Honeybee-Model.
"""

import scriptcontext as sc
import Rhino as rh
import rhinoscriptsyntax as rs
import ghpythonlib.components as ghc
import Grasshopper as gh

try:
    from ph_gh_component_io import gh_io
except ImportError as e:
    raise ImportError('\nFailed to import ph_gh_component_io:\n\t{}'.format(e))

try:
    from honeybee_revive_rhino import gh_compo_io
except ImportError as e:
    raise ImportError('\nFailed to import honeybee_revive_rhino:\n\t{}'.format(e))


# ------------------------------------------------------------------------------
import honeybee_revive_rhino._component_info_
reload(honeybee_revive_rhino._component_info_)
ghenv.Component.Name = "HB-REVIVE - Create CO2 Reduction Measure"
DEV = honeybee_revive_rhino._component_info_.set_component_params(ghenv, dev=False)
if DEV:
    from honeybee_revive_rhino.gh_compo_io.model import create_CO2_measure as gh_compo_io
    reload(gh_compo_io)

# ------------------------------------------------------------------------------
# -- GH Interface
IGH = gh_io.IGH( ghdoc, ghenv, sc, rh, rs, ghc, gh )

# ------------------------------------------------------------------------------
gh_compo_interface = gh_compo_io.GHCompo_CreateCO2ReductionMeasure(
        IGH,
        _name,
        _measure_type,
        _year,
        _cost,
        _kg_CO2,
        _country_name,
        _labor_fraction,
)
measure_ = gh_compo_interface.run()
print(measure_)
# ---------- end create_co2_reduction_measure ----------
add_co2_reduction_measures_to_model = HBREVIVEAddCO2ReductionMeasuresToModel(
    measures=flatten([load_revive_co2_measures_from_standards.measures, create_co2_reduction_measure.measure]),
    model=model.model)  # -> out, model; inputs measures: list; disabled
# ---------- add_co2_reduction_measures_to_model: Python ----------
#
# Honeybee-REVIVE: A Plugin for calculating Phius REVIVE using LadybugTools Honeybee-Energy Models
# 
# This component is part of the PH-Tools toolkit <https://github.com/PH-Tools>.
# 
# Copyright (c) 2024, PH-Tools and bldgtyp, llc <phtools@bldgtyp.com> 
# Honeybee-REVIVE is free software; you can redistribute it and/or modify 
# it under the terms of the GNU General Public License as published 
# by the Free Software Foundation; either version 3 of the License, 
# or (at your option) any later version. 
# 
# Honeybee-REVIVE is distributed in the hope that it will be useful,
# but WITHOUT ANY WARRANTY; without even the implied warranty of 
# MERCHANTABILITY or FITNESS FOR A PARTICULAR PURPOSE. See the 
# GNU General Public License for more details.
# 
# For a copy of the GNU General Public License
# see <https://github.com/PH-Tools/honeybee_revive/blob/main/LICENSE>.
# 
# @license GPL-3.0+ <http://spdx.org/licenses/GPL-3.0+>
#
"""
Add one or more Phius-REVIVE CO2-Reduction-Measures to a Honeybee-Model.
-
EM October 1, 2024
    Args:
        _measures: (list[Measures]) A list of all of the Phius-REVIVE 
            CO2-Reduction-Measures that you would like to add to the Honeybee-Model.
            
        _model: (Model) The Honeybee Model which you would like to add the 
            Phius-REVIVE CO2-Reduction-Measures to.

    Returns:
        model_: (Model) The Honeybee Model with the Phius-REVIVE 
            CO2-Reduction-Measures added to it.
"""

import scriptcontext as sc
import Rhino as rh
import rhinoscriptsyntax as rs
import ghpythonlib.components as ghc
import Grasshopper as gh

try:
    from ph_gh_component_io import gh_io
except ImportError as e:
    raise ImportError('\nFailed to import ph_gh_component_io:\n\t{}'.format(e))

try:
    from honeybee_revive_rhino import gh_compo_io
except ImportError as e:
    raise ImportError('\nFailed to import honeybee_revive_rhino:\n\t{}'.format(e))


# ------------------------------------------------------------------------------
import honeybee_revive_rhino._component_info_
reload(honeybee_revive_rhino._component_info_)
ghenv.Component.Name = "HB-REVIVE - Add CO2 Reduction Measures to Model"
DEV = honeybee_revive_rhino._component_info_.set_component_params(ghenv, dev=False)
if DEV:
    from honeybee_revive_rhino.gh_compo_io.model import add_CO2_measures_to_model as gh_compo_io
    reload(gh_compo_io)
    
# ------------------------------------------------------------------------------
# -- GH Interface
IGH = gh_io.IGH( ghdoc, ghenv, sc, rh, rs, ghc, gh )

# ------------------------------------------------------------------------------
gh_compo_interface = gh_compo_io.GHCompo_AddCO2ReductionMeasuresToModel(
        IGH,
        _measures,
        _model,
)
model_ = gh_compo_interface.run()
if model_: print(model_.properties.revive.co2_measures)
# ---------- end add_co2_reduction_measures_to_model ----------

# ----
# Debug Outputs
panel_14 = Panel("""Site Surface Ground Temperature
Site Outdoor Air Drybulb Temperature
Site Outdoor Air Wetbulb Temperature
Surface Inside Face Conduction Heat Transfer Energy
Surface Outside Face Conduction Heat Transfer Energy
Surface Average Face Conduction Heat Transfer Energy
Zone Infiltration Sensible Heat Loss Energy
Zone Infiltration Sensible Heat Gain Energy
Zone Infiltration Latent Heat Loss Energy
Zone Infiltration Latent Heat Gain Energy
Zone Infiltration Total Heat Loss Energy
Zone Infiltration Total Heat Gain Energy
Zone Infiltration Current Density Volume Flow Rate
Zone Infiltration Standard Density Volume Flow Rate
Zone Infiltration Current Density Volume
Zone Infiltration Standard Density Volume
Zone Infiltration Mass
Zone Infiltration Mass Flow Rate
Zone Infiltration Air Change Rate""")
boolean_toggle_2 = BooleanToggle(True)
simoutput = HBSimulationOutput(
    zone_energy_use=boolean_toggle_2,
    system_energy_use=boolean_toggle_2,
    gains_and_losses=boolean_toggle_2,
    comfort_metrics=boolean_toggle_2)  # -> out, sim_output; plug-in component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
customoutput = HBCustomSimulationOutput(base_sim_output=simoutput.sim_output, output_names=panel_14)  # -> out, sim_output; plug-in component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
set_resiliency_simulation_output_variabl = HBREVIVESetResiliencySimulationOutputVariables(base_sim_output=customoutput.sim_output)  # -> out, sim_output; "Set Resiliency Simulation Output Variables"
# ---------- set_resiliency_simulation_output_variabl: Python ----------
#
# Honeybee-REVIVE: A Plugin for calculating Phius REVIVE using LadybugTools Honeybee-Energy Models
# 
# This component is part of the PH-Tools toolkit <https://github.com/PH-Tools>.
# 
# Copyright (c) 2024, PH-Tools and bldgtyp, llc <phtools@bldgtyp.com> 
# Honeybee-REVIVE is free software; you can redistribute it and/or modify 
# it under the terms of the GNU General Public License as published 
# by the Free Software Foundation; either version 3 of the License, 
# or (at your option) any later version. 
# 
# Honeybee-REVIVE is distributed in the hope that it will be useful,
# but WITHOUT ANY WARRANTY; without even the implied warranty of 
# MERCHANTABILITY or FITNESS FOR A PARTICULAR PURPOSE. See the 
# GNU General Public License for more details.
# 
# For a copy of the GNU General Public License
# see <https://github.com/PH-Tools/honeybee_revive/blob/main/LICENSE>.
# 
# @license GPL-3.0+ <http://spdx.org/licenses/GPL-3.0+>
#
"""
Setup the PH-REVIVE Simualtion Output variables required.
-
EM October 13, 2024
    Args:
        base_sim_output_: An optional Honeybee-Energy simulation output object to 
            serve as the starting point for the sim_output object returned by 
            this component. All of the required "REVIVE' output names will simply 
            be added to this initial starting object.
    Returns:
        sim_output: A SimulationOutput object that can be connected to the
            "HB Simulation Parameter" component in order to specify which
            types of outputs should be written from EnergyPlus. 
"""

import scriptcontext as sc
import Rhino as rh
import rhinoscriptsyntax as rs
import ghpythonlib.components as ghc
import Grasshopper as gh

try:
    from ph_gh_component_io import gh_io
except ImportError as e:
    raise ImportError('\nFailed to import ph_gh_component_io:\n\t{}'.format(e))

try:
    from honeybee_revive_rhino import gh_compo_io
except ImportError as e:
    raise ImportError('\nFailed to import honeybee_revive_rhino:\n\t{}'.format(e))


# ------------------------------------------------------------------------------
import honeybee_revive_rhino._component_info_
reload(honeybee_revive_rhino._component_info_)
ghenv.Component.Name = "HB-REVIVE - Set Resiliency Simulation Output Variables"
DEV = honeybee_revive_rhino._component_info_.set_component_params(ghenv, dev=False)
if DEV:
    from honeybee_revive_rhino.gh_compo_io.adorb import set_resiliency_output_variables as gh_compo_io
    reload(gh_compo_io)
    

# ------------------------------------------------------------------------------
# -- GH Interface
IGH = gh_io.IGH( ghdoc, ghenv, sc, rh, rs, ghc, gh )

# ------------------------------------------------------------------------------
gh_compo_interface = gh_compo_io.GHCompo_SetResiliencySimulationOutputVariables(
        IGH,
        base_sim_output_,
)
sim_output_ = gh_compo_interface.run()
# ---------- end set_resiliency_simulation_output_variabl ----------

hb_revive_fuel_types = HBREVIVEFuelTypes({"1-Electricity", "2-Natural Gas"}, selected="1-Electricity")
hb_revive_fuel_types_2 = HBREVIVEFuelTypes({"1-Electricity", "2-Natural Gas"}, selected="2-Natural Gas")
adorb_fuel_type = HBREVIVEADORBFuelType(
    fuel_type=hb_revive_fuel_types,
    purchase_price_per_kWH="0.17984 COST/KWH",
    sale_price_per_kWH="0.132 COST/KWH",
    annual_base_cost="200")  # -> out, fuel
# ---------- adorb_fuel_type: Python ----------
#
# Honeybee-REVIVE: A Plugin for calculating Phius REVIVE using LadybugTools Honeybee-Energy Models
# 
# This component is part of the PH-Tools toolkit <https://github.com/PH-Tools>.
# 
# Copyright (c) 2024, PH-Tools and bldgtyp, llc <phtools@bldgtyp.com> 
# Honeybee-REVIVE is free software; you can redistribute it and/or modify 
# it under the terms of the GNU General Public License as published 
# by the Free Software Foundation; either version 3 of the License, 
# or (at your option) any later version. 
# 
# Honeybee-REVIVE is distributed in the hope that it will be useful,
# but WITHOUT ANY WARRANTY; without even the implied warranty of 
# MERCHANTABILITY or FITNESS FOR A PARTICULAR PURPOSE. See the 
# GNU General Public License for more details.
# 
# For a copy of the GNU General Public License
# see <https://github.com/PH-Tools/honeybee_revive/blob/main/LICENSE>.
# 
# @license GPL-3.0+ <http://spdx.org/licenses/GPL-3.0+>
#
"""
Create a new ADORB Fuel type which will be used during the ADORB Calculations.
-
EM November 22, 2024
    Args:
        _fuel_type: Input either:
1-Electricity
2-Natural Gas

        _purchase_price_per_kWH: The cost of a purchased kWH of energy.

        _sale_price_per_kWH: (Optional) Default=0 The sale-price of a kWH of energy. Generally 
            only relevant to electricity which is produced from onsite renewables. 

        _annual_base_cost: (Optional) Default=0 Any additional annual costs for hookups or 
            other fees in addition to the per-kWH costs.

    Returns:
        fuel_: The new fuel type which can be added to 'HB-REVIVE Set Model Properties' which
            will be used during the ADORB calculations.
"""

import scriptcontext as sc
import Rhino as rh
import rhinoscriptsyntax as rs
import ghpythonlib.components as ghc
import Grasshopper as gh

try:
    from ph_gh_component_io import gh_io, preview
except ImportError as e:
    raise ImportError('\nFailed to import ph_gh_component_io:\n\t{}'.format(e))

try:
    from honeybee_revive_rhino import gh_compo_io
except ImportError as e:
    raise ImportError('\nFailed to import honeybee_revive_rhino:\n\t{}'.format(e))


# ------------------------------------------------------------------------------
import honeybee_revive_rhino._component_info_
reload(honeybee_revive_rhino._component_info_)
ghenv.Component.Name = "HB-REVIVE - ADORB Fuel Type"
DEV = honeybee_revive_rhino._component_info_.set_component_params(ghenv, dev=False)
if DEV:
    from honeybee_revive_rhino.gh_compo_io.adorb import create_fuel as gh_compo_io
    reload(gh_compo_io)

# ------------------------------------------------------------------------------
# -- GH Interface
IGH = gh_io.IGH( ghdoc, ghenv, sc, rh, rs, ghc, gh )

# ------------------------------------------------------------------------------
gh_compo_interface = gh_compo_io.GHCompo_CreateADORBFuelType(
        DEV,
        IGH,
        _fuel_type,
        _purchase_price_per_kWH,
        _sale_price_per_kWH,
        _annual_base_cost,
)
fuel_ = gh_compo_interface.run()
preview.object_preview(fuel_)
# ---------- end adorb_fuel_type ----------
adorb_fuel_type_2 = HBREVIVEADORBFuelType(
    fuel_type=hb_revive_fuel_types_2,
    purchase_price_per_kWH="0.0471 COST/KWH",
    sale_price_per_kWH="0.0",
    annual_base_cost="200")  # -> out, fuel; same code as adorb_fuel_type
merge_3 = Merge(Data1=adorb_fuel_type.fuel, Data2=adorb_fuel_type_2.fuel)

# ----
# REVIVE | Config.
hb_revive_grid_regions = HBREVIVEGridRegions({"AZNMc | WECC Southwest": "AZNMc", "CAMXc | WECC California": "CAMXc", "ERCTc | ERCOT All": "ERCTc", "FRCCc | FRCC All": "FRCCc", "MROEc | MRO East": "MROEc", "MROWc | MRO West": "MROWc", "NEWEc | NPCC New England": "NEWEc", "NWPPc | WECC Northwest": "NWPPc", "NYSTc | New York State": "NYSTc", "RFCEc | RFC East": "RFCEc", "RFCMc | RFC Michigan": "RFCMc", "RFCWc | RFC West": "RFCWc", "RMPAc | WECC Rockies": "RMPAc", "SPNOc | SPP North": "SPNOc", "SPSOc | SPP South": "SPSOc", "SRMVc | SERC Mississippi Valley": "SRMVc", "SRMWc | SERC Midwest": "SRMWc", "SRSOc | SERC South": "SRSOc", "SRTVc | SERC Tennessee Valley": "SRTVc", "SRVCc | SERC Virginia/Carolina": "SRVCc"}, selected="RFCEc | RFC East")
hb_revive_country = HBREVIVECountry({"CANADA", "CHINA", "FRANCE", "GERMANY", "INDIA", "IRELAND", "ITALY", "JAPAN", "SOUTH KOREA", "MALAYSIA", "MEXICO", "SWITZERLAND", "TAIWAN", "UNITED KINGDOM", "USA", "VIETNAM"}, selected="USA")
set_model_properties = HBREVIVESetModelProperties(
    country_name=hb_revive_country,
    cambium_grid_region=hb_revive_grid_regions,
    envelope_labor_cost_fraction="0.4",
    fuels=merge_3,
    hb_model=model.model)  # -> out, hb_model; inputs analysis_duration: Int32, fuels: list
# ---------- set_model_properties: Python ----------
#
# Honeybee-REVIVE: A Plugin for calculating Phius REVIVE using LadybugTools Honeybee-Energy Models
# 
# This component is part of the PH-Tools toolkit <https://github.com/PH-Tools>.
# 
# Copyright (c) 2024, PH-Tools and bldgtyp, llc <phtools@bldgtyp.com> 
# Honeybee-REVIVE is free software; you can redistribute it and/or modify 
# it under the terms of the GNU General Public License as published 
# by the Free Software Foundation; either version 3 of the License, 
# or (at your option) any later version. 
# 
# Honeybee-REVIVE is distributed in the hope that it will be useful,
# but WITHOUT ANY WARRANTY; without even the implied warranty of 
# MERCHANTABILITY or FITNESS FOR A PARTICULAR PURPOSE. See the 
# GNU General Public License for more details.
# 
# For a copy of the GNU General Public License
# see <https://github.com/PH-Tools/honeybee_revive/blob/main/LICENSE>.
# 
# @license GPL-3.0+ <http://spdx.org/licenses/GPL-3.0+>
#
"""
Set the Phius-REVIVE ADORB calculation parameters for the Honeybee-Model.
-
EM November 22, 2024
    Args:
        _country_name: (str) The name of the Country the model is located in.

        _cambium_grid_region: (str) Pass in either the name of the Cambium Grid-Region you 
            would like to use (ie: 'AZNMc', etc..) or the filepath to a Cambium Grid-Region
            JSON file that you would like to use for the REVIVE ADORB analysis.
            
        _analysis_duration: (int) The number of years to run the ADORB analysis for.

        _envelope_labor_cost_fraction: (float) The percentage of the envelope cost
            which is related to labor, as opposed to materials.

        _hb_model: (Model) The Honeybee Model to set the REVIVE properties on.

    Returns:
        hb_model_: (Model) The Honeybee Model with the REVIVE properties set.
"""

import scriptcontext as sc
import Rhino as rh
import rhinoscriptsyntax as rs
import ghpythonlib.components as ghc
import Grasshopper as gh

try:
    from ph_gh_component_io import gh_io, preview
except ImportError as e:
    raise ImportError('\nFailed to import ph_gh_component_io:\n\t{}'.format(e))

try:
    from honeybee_revive_rhino import gh_compo_io
except ImportError as e:
    raise ImportError('\nFailed to import honeybee_revive_rhino:\n\t{}'.format(e))


# ------------------------------------------------------------------------------
import honeybee_revive_rhino._component_info_
reload(honeybee_revive_rhino._component_info_)
ghenv.Component.Name = "HB-REVIVE - Set Model Properties"
DEV = honeybee_revive_rhino._component_info_.set_component_params(ghenv, dev=False)
if DEV:
    from honeybee_revive_rhino.gh_compo_io.model import set_model_properties as gh_compo_io
    reload(gh_compo_io)
    
# ------------------------------------------------------------------------------
# -- GH Interface
IGH = gh_io.IGH( ghdoc, ghenv, sc, rh, rs, ghc, gh )

# ------------------------------------------------------------------------------
gh_compo_interface = gh_compo_io.GHCompo_SetModelProperties(
        IGH,
        _country_name,
        _cambium_grid_region,
        _analysis_duration,
        _envelope_labor_cost_fraction,
        _fuels,
        _hb_model,
)
hb_model_ = gh_compo_interface.run()
preview.object_preview(hb_model_.properties.revive)
# ---------- end set_model_properties ----------

run = BooleanToggle(False)

# ----
# Run ADORB Simulation
set_adorb_simulation_output_variables = HBREVIVESetADORBSimulationOutputVariables(base_sim_output=set_resiliency_simulation_output_variabl.sim_output)  # -> out, sim_output
# ---------- set_adorb_simulation_output_variables: Python ----------
#
# Honeybee-REVIVE: A Plugin for calculating Phius REVIVE using LadybugTools Honeybee-Energy Models
# 
# This component is part of the PH-Tools toolkit <https://github.com/PH-Tools>.
# 
# Copyright (c) 2024, PH-Tools and bldgtyp, llc <phtools@bldgtyp.com> 
# Honeybee-REVIVE is free software; you can redistribute it and/or modify 
# it under the terms of the GNU General Public License as published 
# by the Free Software Foundation; either version 3 of the License, 
# or (at your option) any later version. 
# 
# Honeybee-REVIVE is distributed in the hope that it will be useful,
# but WITHOUT ANY WARRANTY; without even the implied warranty of 
# MERCHANTABILITY or FITNESS FOR A PARTICULAR PURPOSE. See the 
# GNU General Public License for more details.
# 
# For a copy of the GNU General Public License
# see <https://github.com/PH-Tools/honeybee_revive/blob/main/LICENSE>.
# 
# @license GPL-3.0+ <http://spdx.org/licenses/GPL-3.0+>
#
"""
Setup the PH-REVIVE ADORB Simualtion Output variables.
-
EM October 13, 2024
    Args:
        base_sim_output_: An optional Honeybee-Energy simulation output object to 
            serve as the starting point for the sim_output object returned by 
            this component. All of the required "REVIVE' output names will simply 
            be added to this initial starting object.
    Returns:
        sim_output: A SimulationOutput object that can be connected to the
            "HB Simulation Parameter" component in order to specify which
            types of outputs should be written from EnergyPlus. 
"""

import scriptcontext as sc
import Rhino as rh
import rhinoscriptsyntax as rs
import ghpythonlib.components as ghc
import Grasshopper as gh

try:
    from ph_gh_component_io import gh_io
except ImportError as e:
    raise ImportError('\nFailed to import ph_gh_component_io:\n\t{}'.format(e))

try:
    from honeybee_revive_rhino import gh_compo_io
except ImportError as e:
    raise ImportError('\nFailed to import honeybee_revive_rhino:\n\t{}'.format(e))


# ------------------------------------------------------------------------------
import honeybee_revive_rhino._component_info_
reload(honeybee_revive_rhino._component_info_)
ghenv.Component.Name = "HB-REVIVE - Set ADORB Simulation Output Variables"
DEV = honeybee_revive_rhino._component_info_.set_component_params(ghenv, dev=False)
if DEV:
    from honeybee_revive_rhino.gh_compo_io.adorb import set_ADORB_output_variables as gh_compo_io
    reload(gh_compo_io)
    

# ------------------------------------------------------------------------------
# -- GH Interface
IGH = gh_io.IGH( ghdoc, ghenv, sc, rh, rs, ghc, gh )

# ------------------------------------------------------------------------------
gh_compo_interface = gh_compo_io.GHCompo_SetADORBSimulationOutputVariables(
        IGH,
        base_sim_output_,
)
sim_output_ = gh_compo_interface.run()
# ---------- end set_adorb_simulation_output_variables ----------
simpar = HBSimulationParameter(output=set_adorb_simulation_output_variables.sim_output, timestep=6)  # -> sim_par; plug-in component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
value_list_2 = ValueList({"Rochester, MN": 1, "NYC, NY": 2, "State College, PA": 3}, selected="Rochester, MN")
ghpython_script_5 = GhPythonScript(weather_folder=weather_save_folder, weather=value_list_2)  # -> out, epw
# ---------- ghpython_script_5: Python ----------
import os

if _weather == 1:
    epw_ = os.path.join(
        _weather_folder,
        "USA_MN_Rochester.Intl.AP.726440_TMY3",
        "USA_MN_Rochester.Intl.AP.726440_TMY3.epw"
    )
elif _weather == 2:
    epw_ = os.path.join(
        _weather_folder,
        "USA_NY_New.York-J.F.Kennedy.Intl.AP.744860_TMY3",
        "USA_NY_New.York-J.F.Kennedy.Intl.AP.744860_TMY3.epw"
    )
elif _weather == 3:
    epw_ = os.path.join(
        _weather_folder,
        "USA_PA_State.College-Penn.State.University.725128_TMY3", 
        "USA_PA_State.College-Penn.State.University.725128_TMY3.epw"
    )
else:
    epw_ = None
# ---------- end ghpython_script_5 ----------
modeltoosm = HBModelToOSM(
    model=set_model_properties.hb_model,
    epw_file=ghpython_script_5.epw,
    sim_par=simpar,
    folder=hb_rv_save_folder,
    write=run,
    run="2")  # -> out, jsons, osw, osm, idf, sql, zsz, rdd, html; plug-in component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

# ----
# Run Phius GUI IDF Simulation
panel_15 = Panel("M_10W-20S_StateCollegePA_BASE_NV_BA.idf")
ghpython_script_6 = GhPythonScript(hb_output=set_adorb_simulation_output_variables.sim_output)  # -> out, add_str
# ---------- ghpython_script_6: Python ----------
idf_str = _hb_output.to_idf()

variable_list = idf_str[1]

add_str_ = []
add_str_.append("OutputControl:Table:Style, CommaAndHTML;")
add_str_.extend(
    [_.replace("*", "").strip().replace("/n", "") for _ in idf_str[1]]
)
add_str_.extend(idf_str[2:])

add_str_ = "\n".join(add_str_)
# ---------- end ghpython_script_6 ----------
ghpython_script_7 = GhPythonScript(folder=phius_gui_idf, file=panel_15)  # -> out, file
# ---------- ghpython_script_7: Python ----------
import os
file_ = os.path.join(_folder, _file)
# ---------- end ghpython_script_7 ----------
run_2 = BooleanToggle(False)
runidf = HBRunIDF(idf=ghpython_script_7.file, epw_file=ghpython_script_5.epw, add_str=ghpython_script_6.add_str, run=run_2)  # -> out, sql, zsz, rdd, html; plug-in component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

material = Panel("""  MATERIAL,
    EPS 2in,                 !- Name
    MediumSmooth,            !- Roughness
    0.0508,                  !- Thickness {m}
    0.02884,                 !- Conductivity {W/m-K}
    29,                      !- Density {kg/m3}
    1210,                    !- Specific Heat {J/kg-K}
    0.9,                     !- Thermal Absorptance
    0.7,                     !- Solar Absorptance
    0.7;                     !- Visible Absorptance""")
foundation_kiva = Panel("""FOUNDATION:KIVA,
    Slab Details,             !- Name
    ,                         !- Initial Indoor Air Temperature
    ,                         !- Interior Horizontal Insulation Material Name
    0,                        !- Interior Horizontal Insulation Depth
    ,                         !- Interior Horizontal Insulation Width
    ,                         !- Interior Vertical Insulation Material Name
    ,                         !- Interior Vertical Insulation Depth
    ,                         !- Exterior Horizontal Insulation Material Name
    ,                         !- Exterior Horizontal Insulation Depth
    0,                        !- Exterior Horizontal Insulation Width
    EPS 2in,                  !- Exterior Vertical Insulation Material Name
    0.0003048,                !- Exterior Vertical Insulation Depth
    0.2,                      !- Wall Height Above Grade
    0,                        !- Wall Depth Below Slab
    ,                         !- Footing Wall Construction Name
    ,                         !- Footing Material Name
    0.4;                      !- Footing Depth
FOUNDATION:KIVA,
    Crawlspace Details,       !- Name
    ,                         !- Initial Indoor Air Temperature
    ,                         !- Interior Horizontal Insulation Material Name
    0,                        !- Interior Horizontal Insulation Depth
    ,                         !- Interior Horizontal Insulation Width
    ,                         !- Interior Vertical Insulation Material Name
    ,                         !- Interior Vertical Insulation Depth
    ,                         !- Exterior Horizontal Insulation Material Name
    ,                         !- Exterior Horizontal Insulation Depth
    0,                        !- Exterior Horizontal Insulation Width
    EPS 2in,                  !- Exterior Vertical Insulation Material Name
    0.0003048,                !- Exterior Vertical Insulation Depth
    0.2,                      !- Wall Height Above Grade
    0,                        !- Wall Depth Below Slab
    ,                         !- Footing Wall Construction Name
    ,                         !- Footing Material Name
    0.4;                      !- Footing Depth
FOUNDATION:KIVA,
    Basement Details,         !- Name
    ,                         !- Initial Indoor Air Temperature
    ,                         !- Interior Horizontal Insulation Material Name
    0,                        !- Interior Horizontal Insulation Depth
    ,                         !- Interior Horizontal Insulation Width
    ,                         !- Interior Vertical Insulation Material Name
    ,                         !- Interior Vertical Insulation Depth
    ,                         !- Exterior Horizontal Insulation Material Name
    ,                         !- Exterior Horizontal Insulation Depth
    0,                        !- Exterior Horizontal Insulation Width
    EPS 2in,                  !- Exterior Vertical Insulation Material Name
    0.0003048,                !- Exterior Vertical Insulation Depth
    0.2,                      !- Wall Height Above Grade
    0,                        !- Wall Depth Below Slab
    ,                         !- Footing Wall Construction Name
    ,                         !- Footing Material Name
    0.4;                      !- Footing Depth""")
surface_property = Panel("""SURFACEPROPERTY:EXPOSEDFOUNDATIONPERIMETER,
    Slab,                     !- Surface Name
    TotalExposedPerimeter,    !- Exposed Perimeter Calculation Method
    12.192,                   !- Total Exposed Perimeter
    1,                        !- Exposed Perimeter Fraction
    Yes;                      !- Surface Segment 1 Exposed
SURFACEPROPERTY:EXPOSEDFOUNDATIONPERIMETER,
    Crawlspace,               !- Surface Name
    TotalExposedPerimeter,    !- Exposed Perimeter Calculation Method
    19.812,                   !- Total Exposed Perimeter
    1,                        !- Exposed Perimeter Fraction
    Yes;                      !- Surface Segment 1 Exposed
SURFACEPROPERTY:EXPOSEDFOUNDATIONPERIMETER,
    Basement,                 !- Surface Name
    TotalExposedPerimeter,    !- Exposed Perimeter Calculation Method
    42.443400000000004,       !- Total Exposed Perimeter
    1,                        !- Exposed Perimeter Fraction
    Yes;                      !- Surface Segment 1 Exposed""")
merge_4 = Merge(Data1=material, Data2=foundation_kiva, Data3=surface_property)

# ----
# Add Kiva Objects
# and monkeypatch the mechanical
# equipment in the IDF
ghpython_script_8 = GhPythonScript(idf=modeltoosm.idf, add_str=merge_4)  # -> out, idf; inputs add_str: list
# ---------- ghpython_script_8: Python ----------
import os

# This is jsut simple brute force script to test. 
# Do not use this for anything real.

if _idf:
    # --------------------------------------------------------------------------------
    # -- Read in the IDF file as text
    with open(_idf, "r") as idf_file:
        lines = idf_file.readlines()
    

    # --------------------------------------------------------------------------------
    # -- MODIFY THE SURFACE BCs

    # -- Find the starting lines
    setpoint_manager, fan, unitary_sys, infil = None, None, None, None
    for i, line in enumerate(lines):
        if "  568FE7," in line:
            wall_568FE7 = i
        elif "  45825F," in line:
            wall_45825F = i
        elif "  64DDB4," in line:
            wall_64DDB4 = i
        elif "  1312C0," in line:
            wall_1312C0 = i
        elif "  Slab," in line:
            slab = i
            print i
        elif "  Basement, " in line:
            basement = i
        elif "  Crawlspace," in line:
            crawlspace = i
        elif "SetpointManager:MultiZone:Humidity:Minimum," in line:
            setpoint_manager = i
        elif "Fan:OnOff," in line:
            fan = i
        elif 'AirLoopHVAC:UnitarySystem,' in line:
            unitary_sys = i
        elif 'ZoneInfiltration:DesignFlowRate,' in line:
            infil = i


    # -- Change the IDF Text
    lines[wall_568FE7+5] = "  Foundation,       !- Outside Boundary Condition\n"
    lines[wall_568FE7+6] = "  Basement Details, !- Outside Boundary Condition Object\n"

    lines[wall_45825F+5] = "  Foundation,       !- Outside Boundary Condition\n"
    lines[wall_45825F+6] = "  Basement Details, !- Outside Boundary Condition Object\n"

    lines[wall_64DDB4+5] = "  Foundation,       !- Outside Boundary Condition\n"
    lines[wall_64DDB4+6] = "  Basement Details, !- Outside Boundary Condition Object\n"

    lines[wall_1312C0+5] = "  Foundation,       !- Outside Boundary Condition\n"
    lines[wall_1312C0+6] = "  Basement Details, !- Outside Boundary Condition Object\n"

    lines[slab+5] = "  Foundation,       !- Outside Boundary Condition\n"
    lines[slab+6] = "  Slab Details,     !- Outside Boundary Condition Object\n"

    lines[basement+5] = "  Foundation,       !- Outside Boundary Condition\n"
    lines[basement+6] = "  Basement Details, !- Outside Boundary Condition Object\n"

    lines[crawlspace+5] = "  Foundation,       !- Outside Boundary Condition\n"
    lines[crawlspace+6] = "  Crawlspace Details,!- Outside Boundary Condition Object\n"

    # -- Remove the humidification
    if setpoint_manager:
        lines[setpoint_manager+3] = "  0.000001,                                  !- Minimum Setpoint Humidity Ratio {kgWater/kgDryAir}\n"

    if fan:
        lines[fan+3] = "  0.7,                                   !- Fan Total Efficiency\n"
        lines[fan+4] = "  225,                             !- Pressure Rise {Pa}\n"
        lines[fan+4] = "  2,                       !- Maximum Flow Rate {m3/s}\n"
        lines[fan+10] = "  ,                 !- Fan Power Ratio Function of Speed Ratio Curve Name\n"
        lines[fan+11] = "  ,            !- Fan Efficiency Ratio Function of Speed Ratio Curve Name\n"
  
    if unitary_sys:
        lines[unitary_sys+39] = "  50,                                     !- Maximum Supply Air Temperature {C}\n"

    if infil:
        lines[infil+7] = "  0.00026436955621,        !- Flow Rate per Exterior Surface Area {m3/s-m2}\n"
        lines[infil+8] = "  0,                       !- Air Changes per Hour {1/hr}\n"
        lines[infil+9] = "  0,                       !- Constant Term Coefficient\n"
        lines[infil+10] = "  0.015,                   !- Temperature Term Coefficient\n"
        lines[infil+11] = "  0.224,                   !- Velocity Term Coefficient\n"

    # --------------------------------------------------------------------------------
    # -- Write a new IDF file with the modified object
    new_idf_file_path = os.path.join(os.path.dirname(_idf), "idf_kiva.idf")
    with open(new_idf_file_path, "w") as new_idf_file:
        for line in lines:
            new_idf_file.write(line)
        
        for add_line in _add_str:
            new_idf_file.write(add_line + "\n")

    idf_ = new_idf_file_path
# ---------- end ghpython_script_8 ----------
run_3 = BooleanToggle(True)
runidf_2 = HBRunIDF(idf=ghpython_script_8.idf, epw_file=ghpython_script_5.epw, run=run_3)  # -> out, sql, zsz, rdd, html; plug-in component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

data_dam = DataDam(DataDataA=runidf.sql, BufferDelay=10000000, BufferMode=0)
data_dam_2 = DataDam(DataDataA=runidf_2.sql, BufferDelay=10000000, BufferMode=0)

# ---- group: Copy ESO Files
button = Button()  # disabled
ghpython_script_9 = GhPythonScript(phius=data_dam, hbph=data_dam_2, run=button)  # -> out, a; disabled
# ---------- ghpython_script_9: Python ----------
import os
import shutil

if _run:
    if _hbph:
        shutil.copyfile(
            os.path.join(os.path.dirname(_hbph), os.path.os.path.splitext(_hbph)[0] + ".eso"),
            "/Users/em/Dropbox/bldgtyp-00/00_PH_Tools/honeybee_REVIVE_grasshopper/tests/adorb/hbph.eso"
        )
    if _phius:
        shutil.copyfile(
            os.path.join(os.path.dirname(_phius), os.path.os.path.splitext(_phius)[0] + ".eso"),
            "/Users/em/Dropbox/bldgtyp-00/00_PH_Tools/honeybee_REVIVE_grasshopper/tests/adorb/phius.eso"
        )
# ---------- end ghpython_script_9 ----------

# ----
# Compare Phius vs. HBRV Model Results
value_list_3 = ValueList({"Zone Lights Total Heating Energy", "Zone People Total Heating Energy", "Zone Electric Equipment Total Heating Energy", "Zone Other Equipment Total Heating Energy", "Zone Ideal Loads Zone Total Heating Energy", "Zone Ideal Loads Zone Total Cooling Energy", "Zone Infiltration Standard Density Volume Flow Rate", "Zone Mechanical Ventilation Standard Density Volume Flow Rate", "Zone Ventilation Standard Density Volume Flow Rate", "Facility Total Purchased Electricity Energy", "Zone Windows Total Transmitted Solar Radiation Energy", "Zone Windows Total Heat Gain Energy", "Zone Windows Total Heat Loss Energy", "Site Surface Ground Temperature", "Site Outdoor Air Drybulb Temperature", "Site Outdoor Air Wetbulb Temperature", "Surface Inside Face Conduction Heat Transfer Energy", "Surface Outside Face Conduction Heat Transfer Energy", "Surface Average Face Conduction Heat Transfer Energy"}, selected="Zone Lights Total Heating Energy")  # disabled
customresult = HBReadCustomResult(sql=data_dam, output_names=value_list_3)  # -> results; disabled; plug-in component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
customresult_2 = HBReadCustomResult(sql=data_dam_2, output_names=value_list_3)  # -> results; disabled; plug-in component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
xdata = LBDeconstructData(data=customresult)  # -> header, values; disabled; plug-in component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
xdata_2 = LBDeconstructData(data=customresult_2)  # -> header, values; disabled; plug-in component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
mass_addition = MassAddition(Input=xdata.values)  # -> Result, PartialResults; disabled
mass_addition_2 = MassAddition(Input=xdata_2.values)  # -> Result, PartialResults; disabled
panel_16 = Panel(mass_addition.Result)  # disabled
panel_17 = Panel(mass_addition_2.Result)  # disabled
cluster_2 = Cluster_2(A=panel_16, B=panel_17)  # disabled
difference = Panel(cluster_2)  # disabled

# ---- group: Save Folder
data = Data(adorb_save_folder)

# ----
# Calculate ADORB Cost
run_4 = BooleanToggle(False)
calculate_adorb_costs = HBREVIVECalculateADORBCosts(folder=data, sql_path=data_dam_2, hb_model=set_model_properties.hb_model, run=run_4)  # -> out, ADORB_costs, yearly_csv_results_file, cumulative_csv_results_file, tables
# ---------- calculate_adorb_costs: Python ----------
#
# Honeybee-REVIVE: A Plugin for calculating Phius REVIVE using LadybugTools Honeybee-Energy Models
# 
# This component is part of the PH-Tools toolkit <https://github.com/PH-Tools>.
# 
# Copyright (c) 2024, PH-Tools and bldgtyp, llc <phtools@bldgtyp.com> 
# Honeybee-REVIVE is free software; you can redistribute it and/or modify 
# it under the terms of the GNU General Public License as published 
# by the Free Software Foundation; either version 3 of the License, 
# or (at your option) any later version. 
# 
# Honeybee-REVIVE is distributed in the hope that it will be useful,
# but WITHOUT ANY WARRANTY; without even the implied warranty of 
# MERCHANTABILITY or FITNESS FOR A PARTICULAR PURPOSE. See the 
# GNU General Public License for more details.
# 
# For a copy of the GNU General Public License
# see <https://github.com/PH-Tools/honeybee_revive/blob/main/LICENSE>.
# 
# @license GPL-3.0+ <http://spdx.org/licenses/GPL-3.0+>
#
"""
Calculate the Phius-REVIVE ADORB costs for the Honeybee-Model.
-
EM December 11, 2024
    Args:

        _name_: (str) An optional variant name to be used for all of the output 
            files. If none is passed, will use the Model's display_name

        _folder_: (str) An optional path to the folder you would like to save
            the output files to. If none is passed, will use the default Honeybee
            simulation path:
            - MacOS > ./Users/{you}/simulatiion/...
            - Windows > someplace...

        _sql_path: (str) The path to the EnergyPlus results SQL file generated by Honeybee-Energy.

        _hb_model: (Model) The Honeybee-Model to calculate the Phius REVIVE ADORB Costs for.
        
        _run: (bool) Set to True to run the calculation.
            
    Returns:
        ADORB_costs_: <Not Implemented Yet>

        yearly_csv_results_file_: That path to the output CSV file with the
            ADORB cost calculated for each year.

        cumulative_csv_results_file_: That path to the output CSV file with the
            ADORB cost calculated cumulatively for each year.

        tables_: The path to the output folder with the detailed table-views from the 
            ADORB calculation.
"""

import scriptcontext as sc
import Rhino as rh
import rhinoscriptsyntax as rs
import ghpythonlib.components as ghc
import Grasshopper as gh

try:
    from ph_gh_component_io import gh_io
except ImportError as e:
    raise ImportError('\nFailed to import ph_gh_component_io:\n\t{}'.format(e))

try:
    from honeybee_revive_rhino import gh_compo_io
except ImportError as e:
    raise ImportError('\nFailed to import honeybee_revive_rhino:\n\t{}'.format(e))


# ------------------------------------------------------------------------------
import honeybee_revive_rhino._component_info_
reload(honeybee_revive_rhino._component_info_)
ghenv.Component.Name = "HB-REVIVE - Calculate ADORB Costs"
DEV = honeybee_revive_rhino._component_info_.set_component_params(ghenv, dev=False)
if DEV:
    from honeybee_revive_rhino.gh_compo_io.adorb import calc_ADORB_costs as gh_compo_io
    reload(gh_compo_io)
    

# ------------------------------------------------------------------------------
# -- GH Interface
IGH = gh_io.IGH( ghdoc, ghenv, sc, rh, rs, ghc, gh )

# ------------------------------------------------------------------------------
gh_compo_interface = gh_compo_io.GHCompo_CalculateADORBCost(
        DEV,
        IGH,
        _name_, 
        _folder_,
        _sql_path,
        _hb_model,
        _run,
)
yearly_csv_results_file_, cumulative_csv_results_file_, tables_ = gh_compo_interface.run()
# ---------- end calculate_adorb_costs ----------
panel_18 = Panel(calculate_adorb_costs.tables)
panel_19 = Panel(calculate_adorb_costs.yearly_csv_results_file)
panel_20 = Panel(calculate_adorb_costs.out)

panel_21 = Panel("1")  # disabled
panel_22 = Panel("0")  # disabled

# ---- group: Phius
panel_23 = Panel("End Uses By Subcategory")  # disabled
readtable = HBReadTabularData(sql=data_dam, table_name=panel_23)  # -> values, col_names, row_names; disabled; plug-in component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
list_item = ListItem(List=readtable.values, Index=panel_21, Wrap=True)  # disabled
list_item_2 = ListItem(List=readtable.values, Index=panel_22, Wrap=True)  # disabled
flatten_tree_2 = FlattenTree(Tree=list_item, Path="{0}")  # disabled
flatten_tree_3 = FlattenTree(Tree=list_item_2, Path="{0}")  # disabled
mass_addition_3 = MassAddition(Input=flatten_tree_2)  # -> Result, PartialResults; disabled
mass_addition_4 = MassAddition(Input=flatten_tree_3)  # -> Result, PartialResults; disabled

# ---- group: HBPH
panel_24 = Panel("End Uses By Subcategory")  # disabled
readtable_2 = HBReadTabularData(sql=data_dam_2, table_name=panel_24)  # -> values, col_names, row_names; disabled; plug-in component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
list_item_3 = ListItem(List=readtable_2.values, Index=panel_21, Wrap=True)  # disabled
list_item_4 = ListItem(List=readtable_2.values, Index=panel_22, Wrap=True)  # disabled
flatten_tree_4 = FlattenTree(Tree=list_item_3, Path="{0}")  # disabled
flatten_tree_5 = FlattenTree(Tree=list_item_4, Path="{0}")  # disabled
mass_addition_5 = MassAddition(Input=flatten_tree_4)  # -> Result, PartialResults; disabled
mass_addition_6 = MassAddition(Input=flatten_tree_5)  # -> Result, PartialResults; disabled

# ----
generate_adorb_output_graphs = HBREVIVEGenerateADORBOutputGraphs(adorb_costs_csv=calculate_adorb_costs.cumulative_csv_results_file, folder=data)  # -> out, output
# ---------- generate_adorb_output_graphs: Python ----------
#
# Honeybee-REVIVE: A Plugin for calculating Phius REVIVE using LadybugTools Honeybee-Energy Models
# 
# This component is part of the PH-Tools toolkit <https://github.com/PH-Tools>.
# 
# Copyright (c) 2024, PH-Tools and bldgtyp, llc <phtools@bldgtyp.com> 
# Honeybee-REVIVE is free software; you can redistribute it and/or modify 
# it under the terms of the GNU General Public License as published 
# by the Free Software Foundation; either version 3 of the License, 
# or (at your option) any later version. 
# 
# Honeybee-REVIVE is distributed in the hope that it will be useful,
# but WITHOUT ANY WARRANTY; without even the implied warranty of 
# MERCHANTABILITY or FITNESS FOR A PARTICULAR PURPOSE. See the 
# GNU General Public License for more details.
# 
# For a copy of the GNU General Public License
# see <https://github.com/PH-Tools/honeybee_revive/blob/main/LICENSE>.
# 
# @license GPL-3.0+ <http://spdx.org/licenses/GPL-3.0+>
#
"""
Output graphs of the calculated ADORB cost values.
-
EM November 15, 2024
    Args:
        _adorb_costs_csv: The CSV file with the ADORB costs to graph

        _folder_: (Optional) An optional path to a folder to save the graphs 
            to. If none is provided, the default Ladbybug Tools folder will be 
            used as the save folder.

    Returns:       
        output_: The path to the output files.
"""

import scriptcontext as sc
import Rhino as rh
import rhinoscriptsyntax as rs
import ghpythonlib.components as ghc
import Grasshopper as gh

try:
    from ph_gh_component_io import gh_io
except ImportError as e:
    raise ImportError('\nFailed to import ph_gh_component_io:\n\t{}'.format(e))

try:
    from honeybee_revive_rhino import gh_compo_io
except ImportError as e:
    raise ImportError('\nFailed to import honeybee_revive_rhino:\n\t{}'.format(e))


# ------------------------------------------------------------------------------
import honeybee_revive_rhino._component_info_
reload(honeybee_revive_rhino._component_info_)
ghenv.Component.Name = "HB-REVIVE - Generate ADORB Output Graphs"
DEV = honeybee_revive_rhino._component_info_.set_component_params(ghenv, dev=False)
if DEV:
    from honeybee_revive_rhino.gh_compo_io.adorb import generate_graphs as gh_compo_io
    reload(gh_compo_io)
    

# ------------------------------------------------------------------------------
# -- GH Interface
IGH = gh_io.IGH( ghdoc, ghenv, sc, rh, rs, ghc, gh )

# ------------------------------------------------------------------------------
gh_compo_interface = gh_compo_io.GHCompo_GenerateADORBGraphs(
        False,
        IGH,
        _adorb_costs_csv,
        _folder_,
)
output_ = gh_compo_interface.run()
# ---------- end generate_adorb_output_graphs ----------
panel_25 = Panel(generate_adorb_output_graphs.out)
panel_26 = Panel(generate_adorb_output_graphs.output)

panel_27 = Panel(calculate_adorb_costs.cumulative_csv_results_file)

panel_28 = Panel(readtable_2.row_names)  # disabled

# ----
# Natural Gas
panel_29 = Panel(mass_addition_3.Result)  # disabled
phius_gui = Panel(flatten_tree_2)  # disabled
hbph = Panel(flatten_tree_4)  # disabled
panel_30 = Panel(mass_addition_5.Result)  # disabled

# ----
# Electricity
phius_gui_2 = Panel(flatten_tree_3)  # disabled
panel_31 = Panel(mass_addition_4.Result)  # disabled
hbph_2 = Panel(flatten_tree_5)  # disabled
panel_32 = Panel(mass_addition_6.Result)  # disabled

# ==== cluster Cluster
hb_objs = ClusterInput()
facesbytype = HBFacesByType(hb_objs=hb_objs)  # -> walls, interior_walls, roofs, ceilings, exterior_floors, interior_floors, air_walls, apertures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; plug-in component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
vizquick = HBVisualizeQuick(hb_objs=flatten(facesbytype.roofs))  # -> geo; plug-in component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
unit_z = UnitZ(Factor="0.25")
move = Move(Geometry=vizquick, Motion=unit_z)  # -> Geometry, Transform
geometry = ClusterOutput(move.Geometry)

# ==== cluster Cluster_2
A = ClusterInput()
B = ClusterInput()
subtraction = Subtraction(A=A, B=B)
absolute = Absolute(Value=subtraction)
round = Round(Number=absolute)  # -> Nearest, Floor, Ceiling
nearest = ClusterOutput(round.Nearest)
